# Grasshopper definition MiniTown.gh (Grasshopper 1.0.7)

number_slider = Slider(100, range=0..100)
nº_buildings = Slider(32, range=15..40)
rectangle = Rectangle(Plane=PlaneXY(0, 0, 0), XSize=number_slider, YSize=number_slider, Radius=0)  # -> Rectangle, Length
distance_between_buildings = Slider(2.1, range=1..5)
boundary = BoundarySurfaces(Edges=rectangle.Rectangle)
nbuildings = GetInteger(nº_buildings, AtLeast=1, AtMost=1, Maximum=2147483647, Minimum=-2147483648, TreeAccess=False)
popgeo = PopulateGeometry(Geometry=boundary, Count=nbuildings, Seed=1)
distance = GetInteger(distance_between_buildings, AtLeast=1, AtMost=1, Maximum=2147483647, Minimum=-2147483648, TreeAccess=False)
building_height_random = Slider(150, range=4..150)
voronoi = Voronoi(Points=popgeo, Radius=Slider(20, range=0..20), Boundary=rectangle.Rectangle, BruteForceOverride=False)
neg = Negative(Value=distance)
height = GetInteger(building_height_random, AtLeast=1, AtMost=1, Maximum=2147483647, Minimum=-2147483648, TreeAccess=False)
offset = OffsetCurve(Curve=voronoi, Distance=neg, Corners=1)
dom = ConstructDomain(DomainStart=Slider(10, range=0..10), DomainEnd=Slider(51, range=4..100))
range = Range(Domain=dom, Steps=height)
random = Random(Range=range, Number="1", Seed=Slider(7, range=0..100))
fillet = Fillet(Curve=offset, Radius=Slider(6.1, range=0..10))
Z = UnitZ(Factor=random)
extr = Extrude(Base=fillet, Direction=Z)
capex = CapHolesEx(Brep=extr)  # -> Brep, Caps, Solid
context_bake = ContextBake(Geometry=capex.Brep)
